% Simulink data dictionary mmcs_s2f_dd.sldd

iq_ref = Simulink.Signal(StorageClass="ExportedGlobal", DataType="int16")
theta_e = Simulink.Signal(StorageClass="ExportedGlobal", DataType="int16")
mcu_ccrx = Simulink.Signal(StorageClass="ExportedGlobal", DataType="uint16")
id_ref = Simulink.Signal(StorageClass="ExportedGlobal", DataType="int16")
i_alpha = Simulink.Signal(StorageClass="ExportedGlobal", DataType="int16")
i_beta = Simulink.Signal(StorageClass="ExportedGlobal", DataType="int16")
id = Simulink.Signal(StorageClass="ExportedGlobal", DataType="int16")
iq = Simulink.Signal(StorageClass="ExportedGlobal", DataType="int16")
id_err = Simulink.Signal(StorageClass="ExportedGlobal", DataType="int16")
iq_err = Simulink.Signal(StorageClass="ExportedGlobal", DataType="int16")
ud = Simulink.Signal(StorageClass="ExportedGlobal", DataType="int16")
uq = Simulink.Signal(StorageClass="ExportedGlobal", DataType="int16")
u_alpha = Simulink.Signal(StorageClass="ExportedGlobal", DataType="int16")
u_beta = Simulink.Signal(StorageClass="ExportedGlobal", DataType="int16")
ia = Simulink.Signal(StorageClass="ExportedGlobal", DataType="int16")
ib = Simulink.Signal(StorageClass="ExportedGlobal", DataType="int16")
spd_fed = Simulink.Signal(StorageClass="ExportedGlobal", DataType="int16")
stm_state = Simulink.Signal(StorageClass="ExportedGlobal", DataType="uint8")
move_duration = Simulink.Signal(StorageClass="ExportedGlobal", DataType="single", InitialValue="3")
pos_ref = Simulink.Signal(StorageClass="ExportedGlobal", DataType="single", InitialValue="0")
motor_start = Simulink.Signal(StorageClass="ExportedGlobal", DataType="uint8", InitialValue="0")
ct_ctrl_mode = Simulink.Signal(StorageClass="ExportedGlobal", DataType="uint8")
w_dot = Simulink.Signal(StorageClass="ExportedGlobal", DataType="int16", InitialValue="0")
i_alpha_dot = Simulink.Signal(StorageClass="ExportedGlobal", DataType="int32")
i_beta_dot = Simulink.Signal(StorageClass="ExportedGlobal", DataType="int32")
e_alpha_dot = Simulink.Signal(StorageClass="ExportedGlobal", DataType="int32")
e_beta_dot = Simulink.Signal(StorageClass="ExportedGlobal", DataType="int32")
spd_sensor = Simulink.Signal(StorageClass="ExportedGlobal", DataType="int16", InitialValue="0")
DIVSQRT_3 = Simulink.Parameter(18918, StorageClass="Define", HeaderFile="model_param.h", DataType="uint32")
VBUS = Simulink.Parameter(24, StorageClass="Define", HeaderFile="model_param.h", DataType="single")
ALIGN_FINAL_SPEED = Simulink.Parameter(0, StorageClass="Define", HeaderFile="model_param.h", DataType="int16")
AMPTOS16 = Simulink.Parameter(3277, StorageClass="Define", HeaderFile="model_param.h", DataType="uint16")
IF_CTRL = Simulink.Parameter(1, StorageClass="Define", HeaderFile="model_param.h", DataType="uint8")
ENC_ST_CTRL = Simulink.Parameter(2, StorageClass="Define", HeaderFile="model_param.h", DataType="uint8")
STO_ST_CTRL = Simulink.Parameter(3, StorageClass="Define", HeaderFile="model_param.h", DataType="uint8")
ENC_PT_CTRL = Simulink.Parameter(4, StorageClass="Define", HeaderFile="model_param.h", DataType="uint8")
POS_CTRL = Simulink.Parameter(2, StorageClass="Define", HeaderFile="model_param.h", DataType="uint8")
SPD_CTRL = Simulink.Parameter(1, StorageClass="Define", HeaderFile="model_param.h", DataType="uint8")
TORQ_CTRL = Simulink.Parameter(0, StorageClass="Define", HeaderFile="model_param.h", DataType="uint8")
STM_INIT = Simulink.Parameter(1, StorageClass="Define", HeaderFile="model_param.h", DataType="uint8")
STM_IDLE = Simulink.Parameter(2, StorageClass="Define", HeaderFile="model_param.h", DataType="uint8")
STM_PREPARE = Simulink.Parameter(3, StorageClass="Define", HeaderFile="model_param.h", DataType="uint8")
STM_ALIGN = Simulink.Parameter(4, StorageClass="Define", HeaderFile="model_param.h", DataType="uint8")
STM_IFRUN = Simulink.Parameter(5, StorageClass="Define", HeaderFile="model_param.h", DataType="uint8")
STM_STRUN = Simulink.Parameter(6, StorageClass="Define", HeaderFile="model_param.h", DataType="uint8")
STM_STOP = Simulink.Parameter(9, StorageClass="Define", HeaderFile="model_param.h", DataType="uint8")
STM_PTRUN = Simulink.Parameter(7, StorageClass="Define", HeaderFile="model_param.h", DataType="uint8")
STM_ANY_STOP = Simulink.Parameter(8, StorageClass="Define", HeaderFile="model_param.h", DataType="uint8")
STM_STOP_IDLE = Simulink.Parameter(10, StorageClass="Define", HeaderFile="model_param.h", DataType="uint8")
PWM_FREQUENCY = Simulink.Parameter(10000, StorageClass="Define", HeaderFile="model_param.h", DataType="uint16")
STO_F1 = Simulink.Parameter(4096, StorageClass="Define", HeaderFile="model_param.h", DataType="int16")
STO_F2 = Simulink.Parameter(4096, StorageClass="Define", HeaderFile="model_param.h", DataType="int16")
STO_EST_MAX = Simulink.Parameter(134213632, StorageClass="Define", HeaderFile="model_param.h", DataType="int32")
STO_EST_MIN = Simulink.Parameter(-134213632, StorageClass="Define", HeaderFile="model_param.h", DataType="int32")
RAD2RPM_F_NUM = Simulink.Parameter(9549, StorageClass="Define", HeaderFile="model_param.h", DataType="uint16")
RAD2RPM_F_DEN = Simulink.Parameter(1000, StorageClass="Define", HeaderFile="model_param.h", DataType="uint16")
RADTOS16_I = Simulink.Parameter(10430, StorageClass="Define", HeaderFile="model_param.h", DataType="uint16")
STM_SWITCH = Simulink.Parameter(11, StorageClass="Define", HeaderFile="model_param.h", DataType="uint8")
STOMS = Simulink.Parameter(1000, StorageClass="Define", HeaderFile="model_param.h", DataType="uint16")
STM_START = Simulink.Parameter(12, StorageClass="Define", HeaderFile="model_param.h", DataType="uint8")
RADTOS16_F = Simulink.Parameter(10430.38, StorageClass="Define", HeaderFile="model_param.h", DataType="single")
SPD_SAMPLE_FREQ = Simulink.Parameter(500, StorageClass="Define", HeaderFile="model_param.h", DataType="uint16")
HALL_ST_CTRL = Simulink.Parameter(5, StorageClass="Define", HeaderFile="model_param.h", DataType="uint8")
MOTOR_TYPE_TG5P60 = Simulink.Parameter(3, StorageClass="Define", HeaderFile="model_param.h", DataType="uint8")
MOTOR_TYPE_TB2P = Simulink.Parameter(11, StorageClass="Define", HeaderFile="model_param.h", DataType="uint8")
PWM_PERIOD_CYCLES_HALF = Simulink.Parameter(3600, StorageClass="Define", HeaderFile="model_param.h", DataType="uint16")
INT16_MIN = Simulink.Parameter(-32768, DataType="int16")
INT16_MAX = Simulink.Parameter(32767, DataType="int16")
iab_adc = Simulink.Signal(StorageClass="ExportedGlobal", DataType="int16")
pos_ref_int = Simulink.Signal(StorageClass="ExportedGlobal", DataType="int32", InitialValue="0")
pos_fed = Simulink.Signal(StorageClass="ExportedGlobal", DataType="int32", InitialValue="0")
theta_sensor = Simulink.Signal(StorageClass="ExportedGlobal", DataType="int16", InitialValue="0")
ALIGN_DURATION = Simulink.Parameter(700, StorageClass="Define", HeaderFile="model_param.h", DataType="uint16")
MOTOR_TYPE_JSF630 = Simulink.Parameter(21, StorageClass="Define", HeaderFile="model_param.h", DataType="uint8")
ALIGN_INIT_CURRENT = Simulink.Parameter(1638, StorageClass="Define", HeaderFile="model_param.h", DataType="int16")
ALIGN_THETA = Simulink.Parameter(2731, StorageClass="Define", HeaderFile="model_param.h", DataType="int16")
PWM_PERIOD_CYCLES = Simulink.Parameter(7200, StorageClass="Define", HeaderFile="model_param.h", DataType="uint16")
IF_ACC_DURATION = Simulink.Parameter(1500, StorageClass="Define", HeaderFile="model_param.h", DataType="uint16")
ALIGN_FINAL_CURRENT = Simulink.Parameter(3277, StorageClass="Define", HeaderFile="model_param.h", DataType="int16")
T_MF_TASK = Simulink.Parameter(0.002, StorageClass="Define", HeaderFile="model_param.h")
T_HF_TASK = Simulink.Parameter(0.0001, StorageClass="Define", HeaderFile="model_param.h")
S16_NEG90 = Simulink.Parameter(938, StorageClass="Define", HeaderFile="model_param.h", DataType="int16")
IF_FINAL_SPEED = Simulink.Parameter(600, StorageClass="Define", HeaderFile="model_param.h", DataType="int16")
IF_FINAL_SPEED_LOL = Simulink.Parameter(-600, StorageClass="Define", HeaderFile="model_param.h", DataType="int16")
IF_FINAL_SPEED_UPL = Simulink.Parameter(600, StorageClass="Define", HeaderFile="model_param.h", DataType="int16")
spd_ref = Simulink.Signal(StorageClass="ExportedGlobal", DataType="int16", InitialValue="1000")
IF_INIT_CURRENT = Simulink.Parameter(1638, StorageClass="Define", HeaderFile="model_param.h", DataType="int16")
IF_FINAL_CURRENT_UPL = Simulink.Parameter(3277, StorageClass="Define", HeaderFile="model_param.h", DataType="int16")
IF_FINAL_CURRENT = Simulink.Parameter(3277, StorageClass="Define", HeaderFile="model_param.h", DataType="int16")
IF_FINAL_CURRENT_LOL = Simulink.Parameter(-3277, StorageClass="Define", HeaderFile="model_param.h", DataType="int16")
REF_CURRENT_UPL = Simulink.Parameter(11470, StorageClass="Define", HeaderFile="model_param.h", DataType="int16")
REF_CURRENT_LOL = Simulink.Parameter(-11470, StorageClass="Define", HeaderFile="model_param.h", DataType="int16")

PosCtrlHandle_t = Simulink.Bus(DataScope="Imported", HeaderFile="trajectory_ctrl.h")
  start_angle: single
  angle_step: single
  final_angle: single
  move_duration: single
  sub_step: single[7]
  sub_step_duration: single
  elapse_time: single
  sample_time: single
  jerk: single
  cruise_spd: single
  acceleration: single
  omega: single
  theta: single
  tc_sts: uint8

MOTOR_TYPE = Simulink.Parameter(21, StorageClass="Define", HeaderFile="model_param.h", DataType="uint8")
sys_ctrl_mode = Simulink.Signal(StorageClass="ExportedGlobal", DataType="uint8", InitialValue="ENC_ST_CTRL")
MOTOR_PNF = Simulink.Parameter(4, StorageClass="Define", HeaderFile="model_param.h")
MOTOR_PN = Simulink.Parameter(uint8(4), StorageClass="Define", HeaderFile="model_param.h")
MOTOR_RS = Simulink.Parameter(0.445, StorageClass="Define", HeaderFile="model_param.h")
MOTOR_LS = Simulink.Parameter(0.00031, StorageClass="Define", HeaderFile="model_param.h")
MOTOR_KE = Simulink.Parameter(5.656, StorageClass="Define", HeaderFile="model_param.h")
MOTOR_J = Simulink.Parameter(2.8e-6, StorageClass="Define", HeaderFile="model_param.h")
MOTOR_F = Simulink.Parameter(7.0e-6, StorageClass="Define", HeaderFile="model_param.h")
MOTOR_TL = Simulink.Parameter(0.001, StorageClass="Define", HeaderFile="model_param.h")
ENC_PULSE_NUM = Simulink.Parameter(uint16(4000), StorageClass="Define", HeaderFile="model_param.h")
U32MAXdivPulseNumber = Simulink.Parameter(uint32(1073741), StorageClass="Define", HeaderFile="model_param.h")
PI_KP_TQ = Simulink.Parameter(fi(0.6399994, 1, 32, 16), StorageClass="Define", HeaderFile="model_param.h", DataType="fixdt(1,32,16)")
PI_KI_TQ = Simulink.Parameter(fi(922, 1, 32, 16), StorageClass="Define", HeaderFile="model_param.h", DataType="fixdt(1,32,16)")
PI_KP_SPD = Simulink.Parameter(fi(2.072998, 1, 32, 16), StorageClass="Define", HeaderFile="model_param.h", DataType="fixdt(1,32,16)")
PI_KI_SPD = Simulink.Parameter(fi(5.182999, 1, 32, 16), StorageClass="Define", HeaderFile="model_param.h", DataType="fixdt(1,32,16)")
PI_KP_POS = Simulink.Parameter(fi(1, 1, 32, 16), StorageClass="Define", HeaderFile="model_param.h", DataType="fixdt(1,32,16)")
PI_KI_POS = Simulink.Parameter(fi(1, 1, 32, 16), StorageClass="Define", HeaderFile="model_param.h", DataType="fixdt(1,32,16)")
PI_KP_PLL = Simulink.Parameter(fi(0.0717926, 1, 32, 16), StorageClass="Define", HeaderFile="model_param.h", DataType="fixdt(1,32,16)")
PI_KI_PLL = Simulink.Parameter(fi(0.01499939, 1, 32, 16), StorageClass="Define", HeaderFile="model_param.h", DataType="fixdt(1,32,16)")
STO_C1 = Simulink.Parameter(int32(588), StorageClass="Define", HeaderFile="model_param.h")
STO_C2 = Simulink.Parameter(int32(-5703), StorageClass="Define", HeaderFile="model_param.h")
STO_C3 = Simulink.Parameter(int32(1554), StorageClass="Define", HeaderFile="model_param.h")
STO_C4 = Simulink.Parameter(int32(7484), StorageClass="Define", HeaderFile="model_param.h")
STO_C5 = Simulink.Parameter(int32(1831), StorageClass="Define", HeaderFile="model_param.h")